# Grasshopper definition Combinations python 01.gh (Grasshopper 1.0.7)
# plug-ins: HFTidyCanvas

# ----
# https://www.geeksforgeeks.org/python-sort-list-according-second-element-sublist/
tipologia = Panel("""Vivienda A
Vivienda A.1
Vivienda A.2
Vivienda B
Vivienda C""")
nº_dormitorios = Panel("""1D
1D
2D
1D
3D""")
descripcion = Panel("""XXX
BBB
CCC
SSS
KKK""")
superficies = Panel("""30
35
40
50
60""")
merge = Merge(
    Data1=simplify(graft(tipologia)),
    Data2=simplify(graft(superficies)),
    Data3=simplify(graft(nº_dormitorios)),
    Data4=simplify(graft(descripcion)))

panel = Panel(merge)
key = Slider(2, range=0..3)
python = GhPythonScript(TreeToSort=panel, Key=key)  # -> out, a, b; inputs TreeToSort: tree, Key: Int32
# ---------- python: Python ----------
import rhinoscriptsyntax as rs
import Grasshopper.DataTree as dt
import Grasshopper as gh

#grasshopper API
#print x
#print x.BranchCount
#print x.Branches
#print x.DataCount
#print x.TopologyDescription

Key = Key
TreeToSort = TreeToSort
#print Key

#-----------------------------------------------------------------------------------------------------

#step 1. Expand tree structure and append the results to python list.

#Step 1.1 = ¿Cuantas Branches (Ramas) hay?
n_of_branches = TreeToSort.BranchCount
#Step 1.2 = Hacer una lista 'vacia' para ir llenandola
gh_to_py_listlist = []

#Bucle--- Concepto nested loop - loop dentro de otro loop.
#Loop1 = Numero del branch (rama)
#Loop2 = Numero del leaf (Hoja)

for i in range(n_of_branches):
    gh_to_py_listlist.append(TreeToSort.Branch(i))
    # TreeToSort.Branch(i) = A list in each branch
    # Append lists to prepared python list
    
print gh_to_py_listlist


#-----------------------------------------------------------------------------------------------------
#Definimos una funcion - Podemos hacer esto de muchas formas. He encontrado esta la forma mas 'ordenada'.
def Sort(sub_li):
    # reverse = None (Sorts in Ascending order)
    # key is set to sort using second element of 
    # sublist lambda has been used
    # y = Variable, será el indice Key por cual queremos ordenador todo
    sub_li.sort(key = lambda x: x[Key])
    return sub_li

yy = Sort(gh_to_py_listlist)
#print yy
#-----------------------------------------------------------------------------------------------------

#print new_list

def listToTree(nestedList):
    
    """ Convert a nested python iterable to a datatree """
    
    dt = gh.DataTree[object]()
    for i,l in enumerate(nestedList):
        dt.AddRange(l,gh.Kernel.Data.GH_Path(i))
        
    return dt


a = listToTree(yy)

#-----------------------------------------------------------------------------------------------------

#grasshopper API
#print x
#print x.BranchCount
#print x.Branches
#print x.DataCount
#print x.TopologyDescription
# ---------- end python ----------
panel_2 = Panel(python.b)

values = Values(Tree({0}: [4.5429], {1}: [4.5429, 4.5429], {2}: [7.95], {3}: [7.95, 7.95], {4}: [9.0857], {5}: [9.0857, 9.0857]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))
panel_3 = Panel(values)
b_combinaciones = ACombinacionesEstructuraDeDatos(Tree({0}: ["{0}"], {1}: ["{0}", "{0}"], {2}: ["{1}"], {3}: ["{1}", "{1}"], {4}: ["{2}"], {5}: ["{2}", "{2}"]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))
number_slider = Slider(0.608, range=0..1)

# ----
# Compare lists of different lengths in python
# Añadir longitudes reales a encajar
number_slider_2 = Slider(10.86, range=0..30)
number_slider_3 = Slider(6.6, range=0..30)
number_slider_4 = Slider(3.98, range=0..30)
values_2 = Panel("""5.5
6
10
15""")
merge_2 = Merge(Data1=Slider(10.5, range=0..30), Data2=number_slider_2)
lengths = DataDescription(merge_2)
lengths_2 = Panel(lengths)
python_2 = GhPythonScript(coef_Dominio=number_slider, lengths=lengths, values=values_2)  # -> out, a, aa; inputs lengths: list, values: list
# ---------- python_2: Python ----------
import ghpythonlib.treehelpers as th
import rhinoscriptsyntax as rs
import Grasshopper.DataTree as dt
import Grasshopper as gh
import ghpythonlib.treehelpers as th
import Rhino

#-------------------------------------------

values = values
lenghts = lengths
coef_Dominio = coef_Dominio
print values
print lengths
print coef_Dominio
#-------------------------------------------
valuesInside=[]

for length in lengths:
    values1 = []
    count1 = []
    for value in values:
#        print length*coef_Dominio
        if value > length*coef_Dominio and value < length :
            values1.append(value)
    valuesInside.append(values1)
print valuesInside

#list_length = []
#print len(list_length)
#-------------------------------------------
list_length = []
for x in valuesInside:
    lista = []
    lista.append(len(x))
    list_length.append(lista)
a = list_length
#print a
#-------------------------------------------
#-------------------------------------------
def list_length_series(xxx):
    b = []
    count = 0
    for x in xxx: 
        a =[]
        for posicion,x in enumerate(x):
            a.append(posicion)
        b.append(a)
    return b
count = list_length_series(valuesInside)
#print count
#-------------------------------------------
#-------------------------------------------
print ("--------")

def listToTree(nestedList):
    """ Convert a nested python iterable to a datatree """
    dt = gh.DataTree[object]()
    for i,l in enumerate(nestedList):
        dt.AddRange(l,gh.Kernel.Data.GH_Path(i))
        
    return dt
#-----------------------------------------------------
a = listToTree(a)
# ---------- end python_2 ----------
panel_4 = Panel(python_2.out)
panel_5 = Panel(python_2.a)
panel_6 = Panel(python_2.aa)

# ----
# def
python_3 = GhPythonScript(coef_Dominio=number_slider, lengths=lengths, values=values_2)  # -> out; inputs lengths: list, values: list
# ---------- python_3: Python ----------
coef_Dominio = coef_Dominio
lengths = lengths
values = values

print coef_Dominio
print lengths
print values


def valuesInside (lengths,values,coef_Dominio):

    valueInside1 = []
    for length in lengths:
        values1 = []
        count1 = []
        for value in values:
            if value > length*coef_Dominio and value < length:
                values1.append(value)
                valuesInside.append(values1)
    return valueInside1
    print valueInside1

xx = valuesInside(lengths,values,coef_Dominio)
print xx
# ---------- end python_3 ----------

# ----
# Compare lists of different lengths in python
# Añadir longitudes reales a encajar
number_slider_5 = Slider(12.61, range=0..30)
values_3 = Panel("""5.5
6
10
15
23""")
merge_3 = Merge(Data1=number_slider_5, Data2=Slider(5.88, range=0..30))
lengths_3 = DataDescription(merge_3)
lengths_4 = Panel(lengths_3)
python_4 = GhPythonScript(lengths=lengths_3, values=values_3)  # -> out, a; inputs lengths: list, values: list
# ---------- python_4: Python ----------
  
#-------------------------------------------

values = values
lenghts = lengths

#print values
#print lengths

"""valuesInside=[]

for length in lengths:
    for value in values:
        if value > length:
            valuesInside.append(value)

print valuesInside"""

#-------------------------------------------
valuesInside=[]

for length in lengths:
    values1 = []
    for value in values:
        if value > length:
            values1.append(value)
    valuesInside.append(values1)

print valuesInside
print type(valuesInside)


#-------------------------------------------
print ("--------")

"""my_list1 = [[1,2,3]
my_list2 = [3,4,5]]
for i in my_list1:
  for j in my_list2:
    if j==3:
      i.remove(3)
print(my_list)
#Output: [[1, 2], [4, 5]]"""
# ---------- end python_4 ----------
panel_7 = Panel(python_4.out)

panel_8 = Panel(python_3)

# ----
# Enumerate (series) en un nested list
# 3
panel_9 = Panel("https://thispointer.com/python-get-number-of-elements-in-a-list-lists-of-lists-or-nested-list/")
python_5 = GhPythonScript()  # -> out
# ---------- python_5: Python ----------
listOfElements2d = [[1,2,3],["a","b","c","c"]]
#print (listOfElements2d)

# Iterate over the list and add the size of all internal lists 
list_series = []
#--------------------------------------------------
#--------------------------------------------------
b = []
count = 0
#--------------------------------------------------
for x in listOfElements2d:
# En un nested list x = una lista (y no el indice 0 de la lista)
# para acceder al indice de cada lista hay que hacer otro loop (nested loop) 
    a =[]
#    print x
    for posicion,x in enumerate(x):
#        print posicion
        a.append(posicion)
    b.append(a)

print b
#--------------------------------------------------
#--------------------------------------------------
# ---------- end python_5 ----------
panel_10 = Panel(python_5)

series = Series(Start=0, Step=1, Count=Slider(7, range=0..100))
branch = TreeBranch(Tree=panel_3, Path=series, MaintainPaths=True)
branch_2 = TreeBranch(Tree=b_combinaciones, Path=series, MaintainPaths=True)
python_6 = GhPythonScript()  # -> out
# ---------- python_6: Python ----------
listOfElements2d = [[1,2,3],["a","b","c","c"]]

list_series = []
b = []
count = 0

for x in listOfElements2d:
    a =[]
    for posicion,x in enumerate(x):
        a.append(posicion)
    b.append(a)

print b
# ---------- end python_6 ----------

# ----
# Enumerate
# 1
# 2
python_7 = GhPythonScript()  # -> out
# ---------- python_7: Python ----------
lista = [1,2,3,4,5,6,7,8]
for posicion,valor in enumerate(lista):
    print valor
# ---------- end python_7 ----------
python_8 = GhPythonScript()  # -> out
# ---------- python_8: Python ----------
my_list = ["A","B","C","D","E"]
#-------------------------------------------
"""count = 0
for element in my_list:
    print(element)"""
#-------------------------------------------
"""count = 0
for element in my_list:
    print(element)
    if count == 1:
        print ("Count is 1")
    count += 1"""
#-------------------------------------------
"""for x in range(len(my_list)):
    print(my_list[x])
    if x == 1:
        print ("X is 1")"""
#-------------------------------------------
for x, element in enumerate (my_list):
    print(x,element)
    if x == 1:
        print ("X is 1")

#-------------------------------------------
"""my_list = ["A",("B","C"),"D","E"]
b = []

for x, element in enumerate (my_list):
    a = []
#    print(x,element)
    a.append(x)
    print a
    b.append(x)
print b"""
# ---------- end python_8 ----------
panel_11 = Panel(python_7)
panel_12 = Panel(python_8)

# ----
# 3.1 DEF
python_9 = GhPythonScript()  # -> out
# ---------- python_9: Python ----------
listOfElements2d = [[1,2,3],["a","b","c","c"]]
#print (listOfElements2d)"""

def list_length_series(xxx):
    b = []
    count = 0
    for x in xxx: 
        a =[]
        for posicion,x in enumerate(x):
            a.append(posicion)
        b.append(a)
    return b

count = list_length_series(listOfElements2d)

print count
#--------------------------------------------------
#--------------------------------------------------
# ---------- end python_9 ----------

panel_13 = Panel(python_9)

# ----
# Compare lists of different lengths in python
# Añadir longitudes reales a encajar
number_slider_6 = Slider(12.61, range=0..30)
values_4 = Panel("""5.5
6
10
15
23
1
2
23
423
262
12
42
3
13
25""")
merge_4 = Merge(Data1=number_slider_6, Data2=Slider(5.88, range=0..30))
lengths_5 = DataDescription(merge_4)
lengths_6 = Panel(lengths_5)
python_10 = GhPythonScript(lengths=lengths_5, values=values_4)  # -> out, a; inputs lengths: list, values: list; same code as python_4
panel_14 = Panel(python_10.out)

python_11 = GhPythonScript()  # -> out, a
# ---------- python_11: Python ----------
def getSizeOfNestedList(listOfElem):
    ''' Get number of elements in a nested list'''
    count = 0
    # Iterate over the list
    for elem in listOfElem:
        # Check if type of element is list
        if type(elem) == list:  
            # Again call this function to get the size of this element
            count += getSizeOfNestedList(elem)
        else:
            count += 1    
    return count

# Nested List
nestedList = [2 ,3, [44,55,66], 66, [5,6,7, [1,2,3], 6] , 10, [11, [12, [13, 24]]]]
count = getSizeOfNestedList(nestedList)
print('Total Number of elements : ', count)
# ---------- end python_11 ----------
python_12 = GhPythonScript()  # -> out
# ---------- python_12: Python ----------
listOfElements2d = [[1,2,3],["a","b","c","c"]]
list_series = []

b = []
count = 0

for x in listOfElements2d: 
    a =[]
    for posicion,x in enumerate(x):
        a.append(posicion)
    b.append(a)
print b
# ---------- end python_12 ----------
number_slider_7 = Slider(0.5, range=0..1)
panel_15 = Panel(python_11.out)
panel_16 = Panel(python_12)
python_13 = GhPythonScript(lengths=lengths_5, values=values_4)  # -> out, a; inputs lengths: list, values: list
# ---------- python_13: Python ----------
#-------------------------------------------

values = values
lenghts = lengths

#print values
#print lengths

valuesInside=[]

for length in lengths:
    for value in values:
#        print (length, value)
         if value > length:
            valuesInside.append(value)
            valuesInside.append(value)
#            print (value)

print valuesInside
#-------------------------------------------
print ("--------")
# ---------- end python_13 ----------
python_14 = GhPythonScript(lengths=lengths_5, values=values_4)  # -> out, a; inputs lengths: list, values: list
# ---------- python_14: Python ----------
#-------------------------------------------

values = values
lenghts = lengths

#print values
#print lengths

for length in lengths:
    for value in values:
#        print (length, value)
         if value > length:
            print (value,length)
# ---------- end python_14 ----------
panel_17 = Panel(python_14.out)
panel_18 = Panel(python_13.out)

# ----
# Python check if an item is a subset of another list
# Python check if an item is a subset of another list
# Now, we can see how to check if an item is a subset of another list in python
# 
# - In this example, I have taken a variable as a list and assigned search_item = 16, and if condition is used as if search_item in (item for sublist in list for item in sublist), the in keyword is used.
# 
# - If the condition is satisfied it returns “Element is Present” else “Element Not Present”.
python_15 = GhPythonScript()  # -> out, a
# ---------- python_15: Python ----------
list = [[2,4,6,8,10],[1,3,5,7,9],[4,8,12,16,20]]
search_item = 16
if search_item in (item for sublist in list for item in sublist):
   print("Element is Present")
else:
   print("Element Not Present")
# ---------- end python_15 ----------
panel_19 = Panel(python_15.out)

# ----
# Python check if all elements exist in another list
# Python check if all elements exist in another list
# Now, we can see how to check if all elements exist in another list in Python.
# 
# In this example, I have taken two variables as fruits1 and fruits2
# Another variable called new_list is declared and if condition is used, if the new_list condition is satisfied it returns true else it returns false.
# Example:
python_16 = GhPythonScript()  # -> out, a
# ---------- python_16: Python ----------
fruits1 = ['Mango','orange','apple','jackfruit']
fruits2 = ['Mango','orange','apple','jackfruit']
new_list=  all(item in fruits1 for item in fruits2)
if new_list is True:
    print("True")    
else :
    print("False")
# ---------- end python_16 ----------
panel_20 = Panel(python_16.out)

# ----
# Check if a list exists in another list Python
# Python check if a list exists in another list
# Now, we can see how to check if a list exists in another list in Python.
# 
# In this example, I have taken a variable as a list and another variable as a check_list.
# And if condition is used if the check_list is present in the list then the output will be “List is present”, else “List is not present”.
# To get the output, I have used print(“List is present”).
# Example:
python_17 = GhPythonScript()  # -> out, a
# ---------- python_17: Python ----------
list = [[1,5,7,], [2, 3, 4], [3, 6, 9], [4, 8, 12]] 
check_list = [2,3,4]
if check_list in list: 
	print("List is present") 
else: 
	print("List is not present")
# ---------- end python_17 ----------
# Python check if a value exists in a list of list
# Python Comparison Operators: Comparison operators are used to compare two values:
# 
# ==     equal                          x == Y
# !=     Not equal                      x != y
# >      Greater than                   x > y
# <      Less than                      x < y
# >=     Greater than or equal  to      x >= y
# <=     Less than or equal     to      x <= y
# https://pythonguides.com/check-if-a-list-exists-in-another-list-python/
# Python Logical Operators: Comparison operators are used to compare two values:
# 
# and    Returns True if both statements are true                        x < 5 and  x < 10
# or     Returns True if one of the statements is true                   x < 5 or x < 4
# not    Reverse the result, returns False if the result is true         not(x < 5 and x < 10)
# Python Identity Operators: Identity operators are used to compare the objects, not if they are equal, but if they are actually the same object, with the same memory location:
# 
# is       Returns True if both variables are the same object       x is y
# is not   Returns True if both variables are not the same object   x is not y
panel_21 = Panel(python_17.out)

# ----
# Python check if a value exists in a list of lists using itertools.chain()
# Python check if a value exists in a list of lists using itertools.chain()
# Here, we can see how to check if a value exists in a list of lista using itertools.chain in Python.
# 
# In this example, I have imported a module called from itertools. The chain() is the function of itertool that is used to iterate the lists.
# The elements to be searched is given as element_search1 = 40 and element_search2 = 35 to check the given number, I have used result1 = element_search1 in chain(*list).
# If the number is present it returns true value else it returns false. To get the output I have used print((result1), “\n”, (result2)).
# Example:
python_18 = GhPythonScript()  # -> out, a
# ---------- python_18: Python ----------
from itertools import chain 

list = [[5,10,15,20,25], [10,20,30,40], [25,50,75,90]]
element_search1 = 40
element_search2 = 35
result1 = element_search1 in chain(*list) 
result2 = element_search2 in chain(*list) 
print((result1), "\n", (result2))
# ---------- end python_18 ----------
panel_22 = Panel(python_18.out)

# ----
# Check if an element is present in the list of list python
# Here, we can see how to check if a element is present in a list of lists in Python.
# 
# - In this example, I have taken a variable as nested_list and element = 3 and in condition is used result = element in (element for sublist in nested_list for element in sublist). The in keyword is used.
# 
# - To get the output I have used print((result)).
python_19 = GhPythonScript()  # -> out, a
# ---------- python_19: Python ----------
nested_list = [[2,4,6,8], [3,6,9], [4,8,12]] 
element = 3
result = element in (element for sublist in nested_list for element in sublist) 
print((result))
# ---------- end python_19 ----------
panel_23 = Panel(python_19.out)

# ----
# Python check if any elements in the list are in another list
# Python check if any elements in the list are in another list
# Here, we can see how to check if any elements in the list are in another list in Python.
# 
# - In this example, I have taken variable as fruits1 and fruits2 and another list called new_list and assigned as new_list= any(item in fruits1 for item in fruits2), the keyword any is used.
# 
# - The if condition is used if any one item from fruits2 is present in fruits1 then it returns true else it returns false.
# Example:
python_20 = GhPythonScript()  # -> out, a; same code as python_15
panel_24 = Panel(python_20.out)

# ----
# Check if a list contains another list python
# Now, we can see how to Check if a list contain another list in Python.
# 
# - In this example, I have taken a variable as a list, and the if condition is used to check.
# 
# - If the check_list =[“orange”] is present in the list then it returns “List is present” else “List is not present”.
# Example:
python_21 = GhPythonScript()  # -> out, a
# ---------- python_21: Python ----------
list = [["watermelon"], ["mango"], ["orange"], ["apple"]] 
check_list = ["orange"]
if check_list in list: 
	print("List is present") 
else: 
	print("List is not present")
# ---------- end python_21 ----------
panel_25 = Panel(python_21.out)

# ----
# Python Conditions and If statements: 1) if -
# 
# 2) Elif -
# The elif keyword is pythons way of saying "if the previous conditions were not true, then try this condition".
# 
# 3) Else -
# The else keyword catches anything which isn't caught by the preceding conditions
# 
# Example:
# 
# a = 200
# b = 33
# if b > a:
#   print("b is greater than a")
# elif a == b:
#   print("a and b are equal")
# else:
#   print("a is greater than b")
# Añadir longitudes reales a encajar
number_slider_8 = Slider(20, range=0..30)
number_slider_9 = Slider(25, range=0..30)
merge_5 = Merge(Data1=Slider(10, range=0..30))
values_5 = Panel("""5
6
10
15""")
result = DataDescription(merge_5)
panel_26 = Panel(result)
python_22 = GhPythonScript(Dominios=Slider(0.5, range=0..1), Lengths=result, Values=values_5)  # -> out, a; inputs Lengths: list, Values: list
# ---------- python_22: Python ----------
Dominios = Dominios
Lengths = Lengths
Values = Values

print Dominios
print Lengths
print Values

a = []

for i in Values:
    a.append(i)
    print a
# ---------- end python_22 ----------
panel_27 = Panel(python_22.out)

# ----
# Añadir longitudes reales a encajar
number_slider_10 = Slider(20, range=0..30)
merge_6 = Merge(Data1=Slider(10, range=0..30), Data2=number_slider_10, Data3=Slider(25, range=0..30))
values_6 = Panel("""5
6
10
15""")
result_2 = DataDescription(merge_6)
panel_28 = Panel(result_2)
python_23 = GhPythonScript(Dominios=Slider(0.5, range=0..1), Lengths=result_2, Values=values_6)  # -> out, a; inputs Lengths: list, Values: list
# ---------- python_23: Python ----------
"""# Muestra solo números impares - 1,3,5,7,9
for x in xrange(10):
    # Chequéa si x es numero par
    if x % 2 == 0:
        continue
    print x"""
#-----------------------------------------
#-----------------------------------------
# Muestra solo números impares - 1,3,5,7,9
"""for x in xrange(10):
    #sí cumple continua-- #Sí NO cumple se detiene
    #Condición 1
    if x > 5 :
        #Accion1
        print ( "Cumple" )
    #Condición 2
    else:
        #Accion2
        print ( "No cumple" )"""
#-----------------------------------------
#-----------------------------------------

"""a = []
for x in xrange(10):
    print x
    if x > 3 :
        #print a.append(x)
        print ( "No cumple" )
    else:
        print ( "cumple" )"""
#-----------------------------------------
#-----------------------------------------

a = []
for x in xrange(10):
    print x
    if x > 3 :
    a.append(i)
print(a)
#-----------------------------------------
#-----------------------------------------
# ---------- end python_23 ----------
panel_29 = Panel(python_23.out)

panel_30 = Panel(branch_2)
values_7 = Panel(branch)

flatten = FlattenTree(Tree=panel_30, Path="{0}")
lng = ListLength(List=flatten)
panel_31 = Panel(lng)

key_2 = Slider(1, range=0..3)
python_24 = GhPythonScript(Values_To_Replace=panel_30, Values=values_7, Key=key_2)  # -> out, a, b, c; inputs Values_To_Replace: tree, Values: tree, Key: Int32
# ---------- python_24: Python ----------
import rhinoscriptsyntax as rs
import Grasshopper.DataTree as dt
import Grasshopper as gh

Key = Key
Values = Values
Values_To_Replace = Values_To_Replace

#Paso 0 ) Analizamos los inputs - Para entender como entran a python
#print Values_To_Replace
#print Values
#grasshopper API
#print Values.BranchCount
#print Values.Branches
#-----------------------------------------------------------------------------------------------------
#-----------------------------------------------------------------------------------------------------
#-----------------------------------------------------------------------------------------------------
## Paso 1) - CONVERSION GH-PYTHON 
##Cuando metemos una lista como 'tree access' - Utilizamos 'list comprehension' de la siguiente forma convertir los datos
## de grasshopper a datos manejables en python.
Values_To_Replace = [list(i) for i in Values_To_Replace.Branches]
#print Values_To_Replace
#-----------------------------------------------------------------------------------------------------
ValuesA = [list(i) for i in Values.Branches]
#print ValuesA
#-----------------------------------------------------------------------------------------------------
#-----------------------------------------------------------------------------------------------------
#-----------------------------------------------------------------------------------------------------
n_of_branches = Values.BranchCount
#print n_of_branches
gh_to_py_MassAdition = []
gh_to_py_Values = []
for i in range(n_of_branches):
##    print(Values.Branch(i))
    gh_to_py_MassAdition.append(sum(Values.Branch(i)))
    gh_to_py_Values.append(Values.Branch(i))
print gh_to_py_Values
#print gh_to_py_MassAdition
#print len(gh_to_py_MassAdition)
#print Values_To_Replace(gh_to_py_MassAdition)
#print (gh_to_py_MassAdition)
#-----------------------------------------------------
#-----------------------------------------------------
path = []
for i in range(n_of_branches):
    path.append(i)
#print path
#-----------------------------------------------------
#-----------------------------------------------------
#((https://ellibrodepython.com/zip-python)) 'Merge listas'
c = zip(path, gh_to_py_MassAdition,Values_To_Replace)
#print c
#-----------------------------------------------------
#-----------------------------------------------------
#Definimos una funcion - Podemos hacer esto de muchas formas. He encontrado esta la forma mas 'ordenada'.
def Sort(sub_li):
    # reverse = None (Sorts in Ascending order)
    # key is set to sort using second element of 
    # sublist lambda has been used
    # y = Variable, será el indice Key por cual queremos ordenador todo
    sub_li.sort(key = lambda x: x[Key])
    return sub_li
yy = Sort(c)
#print yy
#-----------------------------------------------------
#-----------------------------------------------------
#Una vez he ordenado la lista (nested list), selecciono el index 0. Como es un nested list, tengo que hacer un 
#For loop para meterme dentro de cada lista y seleccionar el index 0. Luego voy rellenando una lista ( aa = []) nueva con append
aa = []
for item in yy:
   #print((item[0]))
   aa.append(item[0])
#print aa
#-----------------------------------------------------
bb = []
for item in yy:
   #print((item[2]))
   bb.append(item[2])
#print bb
#-----------------------------------------------------
#-----------------------------------------------------
#Sacar datos en forma de branches (aptos para continuar en gh)
def listToTree(nestedList):
    """ Convert a nested python iterable to a datatree """
    dt = gh.DataTree[object]()
    for i,l in enumerate(nestedList):
        dt.AddRange(l,gh.Kernel.Data.GH_Path(i))
        
    return dt

a = listToTree(yy)
b = aa
c = listToTree(bb)
#-----------------------------------------------------
#-----------------------------------------------------
# ---------- end python_24 ----------

key_3 = Slider(1, range=0..3)
python_25 = GhPythonScript(Values_To_Replace=panel_30, Values=values_7, Key=key_3)  # -> out, a, b, c; inputs Values_To_Replace: tree, Values: tree, Key: Int32
# ---------- python_25: Python ----------
import rhinoscriptsyntax as rs
import Grasshopper.DataTree as dt
import Grasshopper as gh

Key = Key
Values = Values
Values_To_Replace = Values_To_Replace

#Paso 0 ) Analizamos los inputs - Para entender como entran a python
#print Values_To_Replace
#print Values
#grasshopper API
#print Values.BranchCount
#print Values.Branches
#-----------------------------------------------------------------------------------------------------
#-----------------------------------------------------------------------------------------------------
#-----------------------------------------------------------------------------------------------------
## Paso 1) - CONVERSION GH-PYTHON 
##Cuando metemos una lista como 'tree access' - Utilizamos 'list comprehension' de la siguiente forma convertir los datos
## de grasshopper a datos manejables en python.
Values_To_Replace = [list(i) for i in Values_To_Replace.Branches]
#print Values_To_Replace
#-----------------------------------------------------------------------------------------------------
ValuesA = [list(i) for i in Values.Branches]
#print ValuesA
#-----------------------------------------------------------------------------------------------------
#-----------------------------------------------------------------------------------------------------
#-----------------------------------------------------------------------------------------------------
n_of_branches = Values.BranchCount
#print n_of_branches
gh_to_py_MassAdition = []
#gh_to_py_Values = []
for i in range(n_of_branches):
##    print(Values.Branch(i))
    gh_to_py_MassAdition.append(sum(Values.Branch(i)))
#    gh_to_py_Values.append(Values.Branch(i))
#print gh_to_py_Values
#print gh_to_py_MassAdition
#print len(gh_to_py_MassAdition)
#print Values_To_Replace(gh_to_py_MassAdition)
#print (gh_to_py_MassAdition)
#-----------------------------------------------------
#-----------------------------------------------------
path = []
for i in range(n_of_branches):
    path.append(i)
#print path
#-----------------------------------------------------
#-----------------------------------------------------
#((https://ellibrodepython.com/zip-python)) 'Merge listas'
c = zip(path, gh_to_py_MassAdition,Values_To_Replace)
#print c
#-----------------------------------------------------
#-----------------------------------------------------
#Definimos una funcion - Podemos hacer esto de muchas formas. He encontrado esta la forma mas 'ordenada'.
def Sort(sub_li):
    # reverse = None (Sorts in Ascending order)
    # key is set to sort using second element of 
    # sublist lambda has been used
    # y = Variable, será el indice Key por cual queremos ordenador todo
    sub_li.sort(key = lambda x: x[Key])
    return sub_li
yy = Sort(c)
print yy
#-----------------------------------------------------
#-----------------------------------------------------
#Una vez he ordenado la lista (nested list), selecciono el index 0. Como es un nested list, tengo que hacer un 
#For loop para meterme dentro de cada lista y seleccionar el index 0. Luego voy rellenando una lista ( aa = []) nueva con append
aa = []
for item in yy:
   #print((item[0]))
   aa.append(item[0])
#print aa
#-----------------------------------------------------
bb = []
for item in yy:
   #print((item[2]))
   bb.append(item[2])
#print bb
#-----------------------------------------------------
#-----------------------------------------------------
#Sacar datos en forma de branches (aptos para continuar en gh)
def listToTree(nestedList):
    """ Convert a nested python iterable to a datatree """
    dt = gh.DataTree[object]()
    for i,l in enumerate(nestedList):
        dt.AddRange(l,gh.Kernel.Data.GH_Path(i))
        
    return dt

a = listToTree(yy)
b = aa
c = listToTree(bb)
#-----------------------------------------------------
#-----------------------------------------------------
# ---------- end python_25 ----------

panel_32 = Panel(python_24.b)
panel_33 = Panel(python_24.a)

# ---- group: Coding against the DataTree class / 1
python_26 = GhPythonScript(Values=values_7)  # -> out, a; inputs Values: tree
# ---------- python_26: Python ----------
#import rhinoscriptsyntax as rs
#import Grasshopper.DataTree as dt
#import Grasshopper as gh

Values = Values

#a = []
#print (Values.BranchCount)

for i in range(Values.BranchCount):
    a = []
    branchList = Values.Branch(i)
#    print branchList
    branchPath = Values.Path(i)
#    print branchPath
    for j in range(branchList.Count):
#        print (branchList.Count)
        b = []
        s = str(branchPath)
        s = branchList[j]
        a.append(s)

a = a


print a
# ---------- end python_26 ----------

# ---- group: A simpler way, coding against lists of lists / 2
python_27 = GhPythonScript(Values=values_7)  # -> out; inputs Values: tree
# ---------- python_27: Python ----------
import ghpythonlib.treehelpers as th

Values = Values
x = th.tree_to_list(Values)

print x

a = []

for i,branch in enumerate(x):
    for j,item in enumerate(branch):
        s = str(i) + "[" + str(j) + "] "
        s += type(item).__name__ + ": "
        s += str(item)
        a.append(s)

print a
# ---------- end python_27 ----------

# ---- group: Comprehension list / 3
python_28 = GhPythonScript(Values=values_7)  # -> out; inputs Values: tree
# ---------- python_28: Python ----------
Values = Values

ValuesA = [list(i) for i in Values.Branches]
print ValuesA
# ---------- end python_28 ----------

# ----
panel_34 = Panel(python_25.a)

# ---- group: Coding against the DataTree class
# Acabarlo y entenderlo
panel_35 = Panel(python_26.a)
panel_36 = Panel(python_26.out)

# ---- group: A simpler way, coding against lists of lists
# Acabarlo y entenderlo
panel_37 = Panel(python_27)

# ---- group: Comprehension list
# ¿Como hago MASS ADDITION de un nested list?
panel_38 = Panel(python_28)

# ----
python_29 = GhPythonScript(Values_To_Replace=panel_30, Values=values_7, Key=key_3, longitudEjes=lengths, coef_dominio=number_slider)  # -> out, a, b, c, d, e, f, g, yy; inputs Values_To_Replace: tree, Values: tree, Key: Int32, longitudEjes: list
# ---------- python_29: Python ----------
import rhinoscriptsyntax as rs
import Grasshopper.DataTree as dt
import Grasshopper as gh

Key = Key
Values = Values
Values_To_Replace = Values_To_Replace

#Paso 0 ) Analizamos los inputs - Para entender como entran a python
#print Values_To_Replace
#print Values
#grasshopper API
#print Values.BranchCount
#print Values.Branches
#-----------------------------------------------------------------------------------------------------
#-----------------------------------------------------------------------------------------------------
#-----------------------------------------------------------------------------------------------------
## Paso 1) - CONVERSION GH-PYTHON 
##Cuando metemos una lista como 'tree access' - Utilizamos 'list comprehension' de la siguiente forma convertir los datos
## de grasshopper a datos manejables en python.
Values_To_Replace = [list(i) for i in Values_To_Replace.Branches]
#print Values_To_Replace
#-----------------------------------------------------------------------------------------------------
ValuesA = [list(i) for i in Values.Branches]
#print ValuesA
#-----------------------------------------------------------------------------------------------------
#-----------------------------------------------------------------------------------------------------
#-----------------------------------------------------------------------------------------------------
n_of_branches = Values.BranchCount
#print n_of_branches
gh_to_py_MassAdition = []
#gh_to_py_Values = []
for i in range(n_of_branches):
##    print(Values.Branch(i))
    gh_to_py_MassAdition.append(sum(Values.Branch(i)))
#    gh_to_py_Values.append(Values.Branch(i))
#print gh_to_py_Values
#print gh_to_py_MassAdition
#print len(gh_to_py_MassAdition)
#print Values_To_Replace(gh_to_py_MassAdition)
#print (gh_to_py_MassAdition)
#-----------------------------------------------------
#-----------------------------------------------------
path_number_index = []
for i in range(n_of_branches):
    path_number_index.append(i)
#print path_number_index
#-----------------------------------------------------
#-----------------------------------------------------
#((https://ellibrodepython.com/zip-python)) 'Merge listas'
c = zip(path_number_index, gh_to_py_MassAdition,Values_To_Replace)
#print c
#-----------------------------------------------------
#-----------------------------------------------------
#Definimos una funcion - Podemos hacer esto de muchas formas. He encontrado esta la forma mas 'ordenada'.
def Sort(sub_li):
    # reverse = None (Sorts in Ascending order)
    # key is set to sort using second element of 
    # sublist lambda has been used
    # y = Variable, será el indice Key por cual queremos ordenador todo
    sub_li.sort(key = lambda x: x[Key])
    return sub_li
yy = Sort(c)
#print yy
#-----------------------------------------------------
#-----------------------------------------------------
#Una vez he ordenado la lista (nested list), selecciono el index 0. Como es un nested list, tengo que hacer un 
#For loop para meterme dentro de cada lista y seleccionar el index 0. Luego voy rellenando una lista ( aa = []) nueva con append
path_number = []
for item in yy:
   #print((item[0]))
   path_number.append(item[0])
#print path_number
#-----------------------------------------------------
bb = []
for item in yy:
   #print((item[2]))
   bb.append(item[2])
#print bb
#-----------------------------------------------------
#-----------------------------------------------------
#Sacar datos en forma de branches (aptos para continuar en gh)
def listToTree(nestedList):
    """ Convert a nested python iterable to a datatree """
    dt = gh.DataTree[object]()
    for i,l in enumerate(nestedList):
        dt.AddRange(l,gh.Kernel.Data.GH_Path(i))
        
    return dt
#-----------------------------------------------------
a = listToTree(yy)
b = path_number
c = listToTree(bb)
#-----------------------------------------------------
#-----------------------------------------------------
#-----------------------------------------------------
#Hacemos una nueva lista vacia para introducir ahi la extraccion del index 1-
#de la lista que hemos sorteado anteriormente
MassAdition_Sorted = []
for item in yy:
   #print((item[2]))
   MassAdition_Sorted.append(item[1])
#print MassAdition_Sorted
d = MassAdition_Sorted
#-----------------------------------------------------
#metemos nuevos inputs:
longitudEjes = longitudEjes
coef_dominio = coef_dominio

#print longitudEjes
#print type(longitudEjes)
#print coef_dominio
#print len(longitudEjes)
#-----------------------------------------------------
#-----------------------------------------------------

valuesInside=[]
for i in longitudEjes:
    values1 = []
    for j in MassAdition_Sorted:
        if j > i:
            values1.append(j)
    valuesInside.append(values1)
#print valuesInside
#valuesInside ahora mismo es un nested list pero de python_Por lo tanto hay que 
#pasarlo a la estructura de gh mediante la definicion que hemos hecho antes.
e = listToTree(valuesInside)
print valuesInside
#-----------------------------------------------------
#necesito ahora la longitud de la lista para alimentar a BOB
#ahora mismo 'valuesInside' es un nested list, y si hago len(valuesinside) me va
#a decir el numero de listas que tengo, pero no cuantos items en cada lista (que es lo que quiero)
#en grasshopper sería un list length de un tree.
#Para ello hago un for loop
#-----------------------------------------------------

list_length = []
for x in valuesInside:
    lista = []
#    lista1 = []
    lista.append(len(x))
#    lista1.append(enumerate(x))
    list_length.append(lista)
#    list1_length.append(enumerate(lista))
a = list_length
print a
f = listToTree(a)
#-----------------------------------------------------
"""
def (xxx):
    list_length = []
    for x in valuesInside:
        lista = []
    #    lista1 = []
        lista.append(len(x))
    #    lista1.append(enumerate(x))
        list_length.append(lista)
    #    list1_length.append(enumerate(lista))
    a = list_length
print a
f = listToTree(a)
"""

#-----------------------------------------------------
#-----------------------------------------------------
def list_length_series(xxx):
    b = []
    count = 0
    for x in xxx: 
        a =[]
        for posicion,x in enumerate(x):
            a.append(posicion)
        b.append(a)
    return b
count = list_length_series(valuesInside)
print count
g = listToTree(count)
#-----------------------------------------------------
#-----------------------------------------------------
# ---------- end python_29 ----------
python_30 = GhPythonScript(Values_To_Replace=panel_30, Values=values_7, Key=key_3, longitudEjes=lengths, coef_dominio=number_slider)  # -> out, a, b, c, d, e, f, g; inputs Values_To_Replace: tree, Values: tree, Key: Int32, longitudEjes: list
# ---------- python_30: Python ----------
import rhinoscriptsyntax as rs
import Grasshopper.DataTree as dt
import Grasshopper as gh

Key = Key
Values = Values
Values_To_Replace = Values_To_Replace

#Paso 0 ) Analizamos los inputs - Para entender como entran a python
#print Values_To_Replace
#print Values
#grasshopper API
#print Values.BranchCount
#print Values.Branches
#-----------------------------------------------------------------------------------------------------
#-----------------------------------------------------------------------------------------------------
#-----------------------------------------------------------------------------------------------------
## Paso 1) - CONVERSION GH-PYTHON 
##Cuando metemos una lista como 'tree access' - Utilizamos 'list comprehension' de la siguiente forma convertir los datos
## de grasshopper a datos manejables en python.
Values_To_Replace = [list(i) for i in Values_To_Replace.Branches]
#print Values_To_Replace
#-----------------------------------------------------------------------------------------------------
ValuesA = [list(i) for i in Values.Branches]
#print ValuesA
#-----------------------------------------------------------------------------------------------------
#-----------------------------------------------------------------------------------------------------
#-----------------------------------------------------------------------------------------------------
n_of_branches = Values.BranchCount
#print n_of_branches
gh_to_py_MassAdition = []
#gh_to_py_Values = []
for i in range(n_of_branches):
##    print(Values.Branch(i))
    gh_to_py_MassAdition.append(sum(Values.Branch(i)))
#    gh_to_py_Values.append(Values.Branch(i))
#print gh_to_py_Values
#print gh_to_py_MassAdition
#print len(gh_to_py_MassAdition)
#print Values_To_Replace(gh_to_py_MassAdition)
#print (gh_to_py_MassAdition)
#-----------------------------------------------------
#-----------------------------------------------------
path = []
for i in range(n_of_branches):
    path.append(i)
#print path
#-----------------------------------------------------
#-----------------------------------------------------
#((https://ellibrodepython.com/zip-python)) 'Merge listas'
c = zip(path, gh_to_py_MassAdition,Values_To_Replace)
#print c
#-----------------------------------------------------
#-----------------------------------------------------
#Definimos una funcion - Podemos hacer esto de muchas formas. He encontrado esta la forma mas 'ordenada'.
def Sort(sub_li):
    # reverse = None (Sorts in Ascending order)
    # key is set to sort using second element of 
    # sublist lambda has been used
    # y = Variable, será el indice Key por cual queremos ordenador todo
    sub_li.sort(key = lambda x: x[Key])
    return sub_li
yy = Sort(c)
#print yy
#-----------------------------------------------------
#-----------------------------------------------------
#Una vez he ordenado la lista (nested list), selecciono el index 0. Como es un nested list, tengo que hacer un 
#For loop para meterme dentro de cada lista y seleccionar el index 0. Luego voy rellenando una lista ( aa = []) nueva con append
path_number = []
for item in yy:
   #print((item[0]))
   path_number.append(item[0])
#print path_number
#-----------------------------------------------------
bb = []
for item in yy:
   #print((item[2]))
   bb.append(item[2])
#print bb
#-----------------------------------------------------
#-----------------------------------------------------
#Sacar datos en forma de branches (aptos para continuar en gh)
def listToTree(nestedList):
    """ Convert a nested python iterable to a datatree """
    dt = gh.DataTree[object]()
    for i,l in enumerate(nestedList):
        dt.AddRange(l,gh.Kernel.Data.GH_Path(i))
        
    return dt
#-----------------------------------------------------
a = listToTree(yy)
b = path_number
c = listToTree(bb)
#-----------------------------------------------------
#-----------------------------------------------------
#-----------------------------------------------------
#Hacemos una nueva lista vacia para introducir ahi la extraccion del index 1-
#de la lista que hemos sorteado anteriormente
MassAdition_Sorted = []
for item in yy:
   #print((item[2]))
   MassAdition_Sorted.append(item[1])
#print MassAdition_Sorted
d = MassAdition_Sorted
#-----------------------------------------------------
#metemos nuevos inputs:
longitudEjes = longitudEjes
coef_dominio = coef_dominio

#print longitudEjes
#print type(longitudEjes)
#print coef_dominio
#print len(longitudEjes)
#-----------------------------------------------------
#-----------------------------------------------------

valuesInside=[]
for i in longitudEjes:
    values1 = []
    for j in MassAdition_Sorted:
        if j > i:
            values1.append(j)
    valuesInside.append(values1)
#print valuesInside
#valuesInside ahora mismo es un nested list pero de python_Por lo tanto hay que 
#pasarlo a la estructura de gh mediante la definicion que hemos hecho antes.
e = listToTree(valuesInside)
#-----------------------------------------------------
#necesito ahora la longitud de la lista para alimentar a BOB
#ahora mismo 'valuesInside' es un nested list, y si hago len(valuesinside) me va
#a decir el numero de listas que tengo, pero no cuantos items en cada lista (que es lo que quiero)
#en grasshopper sería un list length de un tree.
#Para ello hago un for loop
#-----------------------------------------------------

list_length = []
for x in valuesInside:
    lista = []
#    lista1 = []
    lista.append(len(x))
#    lista1.append(enumerate(x))
    list_length.append(lista)
#    list1_length.append(enumerate(lista))
a = list_length
print a
f = listToTree(a)
#-----------------------------------------------------
"""
def (xxx):
    list_length = []
    for x in valuesInside:
        lista = []
    #    lista1 = []
        lista.append(len(x))
    #    lista1.append(enumerate(x))
        list_length.append(lista)
    #    list1_length.append(enumerate(lista))
    a = list_length
print a
f = listToTree(a)
"""

#-----------------------------------------------------
#-----------------------------------------------------
def list_length_series(xxx):
    b = []
    count = 0
    for x in xxx: 
        a =[]
        for posicion,x in enumerate(x):
            a.append(posicion)
        b.append(a)
    return b
count = list_length_series(valuesInside)
print count
g = listToTree(count)
#-----------------------------------------------------
#-----------------------------------------------------
# ---------- end python_30 ----------
c = Data(python_29.c)
b = Data(python_29.b)
d = Data(python_29.d)
f = Data(python_29.f)
e = Data(python_29.e)
g = Data(python_29.g)
a = Data(python_29.a)
graph = QuickGraph(python_29.e, SortOrder=0)
panel_39 = Panel(b)
panel_40 = Panel(c)
panel_41 = Panel(d)
panel_42 = Panel(e)
panel_43 = Panel(f)
panel_44 = Panel(g)
panel_45 = Panel(a)

python_31 = GhPythonScript(Values_To_Replace=panel_30, Values=values_7, Key=key_3, longitudEjes=lengths, coef_dominio=number_slider)  # -> out, a, b, c, d, e, f, g, yy; inputs Values_To_Replace: tree, Values: tree, Key: Int32, longitudEjes: list
# ---------- python_31: Python ----------
import rhinoscriptsyntax as rs
import Grasshopper.DataTree as dt
import Grasshopper as gh

Key = Key
Values = Values
Values_To_Replace = Values_To_Replace
#-----------------------------------------------------------------------------------------------------

Values_To_Replace = [list(i) for i in Values_To_Replace.Branches]
#-----------------------------------------------------------------------------------------------------
ValuesA = [list(i) for i in Values.Branches]
#-----------------------------------------------------------------------------------------------------
n_of_branches = Values.BranchCount
gh_to_py_MassAdition = []
for i in range(n_of_branches):
    gh_to_py_MassAdition.append(sum(Values.Branch(i)))
#-----------------------------------------------------
path_number_index = []
for i in range(n_of_branches):
    path_number_index.append(i)
#-----------------------------------------------------
c = zip(path_number_index, gh_to_py_MassAdition,Values_To_Replace)
#-----------------------------------------------------
def Sort(sub_li):
    sub_li.sort(key = lambda x: x[Key])
    return sub_li
yy = Sort(c)
#-----------------------------------------------------
path_number = []
for item in yy:
   path_number.append(item[0])
#-----------------------------------------------------
bb = []
for item in yy:
   bb.append(item[2])
#-----------------------------------------------------
def listToTree(nestedList):
    dt = gh.DataTree[object]()
    for i,l in enumerate(nestedList):
        dt.AddRange(l,gh.Kernel.Data.GH_Path(i))
    return dt
#-----------------------------------------------------
a = listToTree(yy)
b = path_number
c = listToTree(bb)
#-----------------------------------------------------
#-----------------------------------------------------
MassAdition_Sorted = []
for item in yy:
   MassAdition_Sorted.append(item[1])
d = MassAdition_Sorted
#-----------------------------------------------------
longitudEjes = longitudEjes
coef_dominio = coef_dominio
#-----------------------------------------------------
#-----------------------------------------------------
valuesInside=[]
for i in longitudEjes:
    values1 = []
    for j in MassAdition_Sorted:
        if j > i:
            values1.append(j)
    valuesInside.append(values1)
e = listToTree(valuesInside)
#-----------------------------------------------------
list_length = []
for x in valuesInside:
    lista = []
    lista.append(len(x))
    list_length.append(lista)
a = list_length
print a
f = listToTree(a)
#-----------------------------------------------------
def list_length_series(xxx):
    b = []
    count = 0
    for x in xxx: 
        a =[]
        for posicion,x in enumerate(x):
            a.append(posicion)
        b.append(a)
    return b
count = list_length_series(valuesInside)
print count
g = listToTree(count)
#-----------------------------------------------------
# ---------- end python_31 ----------
panel_46 = Panel(python_31.out)
a_2 = Data(python_31.a)
c_2 = Data(python_31.c)
b_2 = Data(python_31.b)
d_2 = Data(python_31.d)
e_2 = Data(python_31.e)
f_2 = Data(python_31.f)
g_2 = Data(python_31.g)
panel_47 = Panel(b_2)
panel_48 = Panel(c_2)
panel_49 = Panel(d_2)
panel_50 = Panel(a_2)
panel_51 = Panel(e_2)
panel_52 = Panel(f_2)
panel_53 = Panel(g_2)

python_32 = GhPythonScript(Values_To_Replace=panel_30, Values=values_7, Key=key_3, longitudEjes=lengths, coef_dominio=number_slider)  # -> out, a, b, c, d, e, f, g, h; inputs Values_To_Replace: tree, Values: tree, Key: Int32, longitudEjes: list
# ---------- python_32: Python ----------
import rhinoscriptsyntax as rs
import Grasshopper.DataTree as dt
import Grasshopper as gh

Key = Key
Values = Values
Values_To_Replace = Values_To_Replace

#print Values_To_Replace
#------------------------------------
def listToTree(nestedList):
    dt = gh.DataTree[object]()
    for i,l in enumerate(nestedList):
        dt.AddRange(l,gh.Kernel.Data.GH_Path(i))
    return dt
#------------------------------------
Values_To_Replace = [list(i) for i in Values_To_Replace.Branches]
ValuesA = [list(i) for i in Values.Branches]
#print Values_To_Replace
#------------------------------------
n_of_branches = Values.BranchCount
gh_to_py_MassAdition = []
for i in range(n_of_branches):
    gh_to_py_MassAdition.append(sum(Values.Branch(i)))
#print gh_to_py_MassAdition
#------------------------------------
path_number_index = []
for i in range(n_of_branches):
    path_number_index.append(i)
#------------------------------------
merge_list = zip(path_number_index, gh_to_py_MassAdition,Values_To_Replace)
print merge_list
#------------------------------------
def Sort_def(sub_li):
    sub_li.sort(key = lambda x: x[Key])
    return sub_li
sorted_list = Sort_def(merge_list)
print sorted_list
a = listToTree(sorted_list)
print a
#------------------------------------
path_number = []
for item in sorted_list:
   path_number.append(item[0])
b = path_number
#------------------------------------
bb = []
for item in sorted_list:
   bb.append(item[2])
c = listToTree(bb)
#------------------------------------
#------------------------------------
MassAdition_Sorted = []
for item in sorted_list:
   MassAdition_Sorted.append(item[1])
d = MassAdition_Sorted
#------------------------------------
longitudEjes = longitudEjes
coef_dominio = coef_dominio
#------------------------------------
def valuesInsidedef(longitudEjes,MassAdition_Sorted):
    longitudEjes = longitudEjes
    MassAdition_Sorted = MassAdition_Sorted
    valuesInside=[]
    for i in longitudEjes:
        values1 = []
        for j in MassAdition_Sorted:
            if j > i:
                values1.append(j)
                valuesInside.append(values1)
    return valuesInside
#    print valuesInside

c = valuesInsidedef(longitudEjes,MassAdition_Sorted)
h = listToTree(c)
#print h

#xxx = valuesInsidedef (longitudEjes,MassAdition_Sorted)
#print xxx

"""
#e = listToTree(valuesInside)
#------------------------------------
list_length = []
for x in valuesInside:
    lista = []
    lista.append(len(x))
    list_length.append(lista)
a = list_length
f = listToTree(a)
#------------------------------------
def list_length_series(xxx):
    b = []
    count = 0
    for x in xxx: 
        a =[]
        for posicion,x in enumerate(x):
            a.append(posicion)
        b.append(a)
    return b
count = list_length_series(valuesInside)
g = listToTree(count)
#------------------------------------
"""
# ---------- end python_32 ----------
a_3 = Data(python_32.a)
c_3 = Data(python_32.c)
b_3 = Data(python_32.b)
d_3 = Data(python_32.d)
e_3 = Data(python_32.e)
f_3 = Data(python_32.f)
g_3 = Data(python_32.g)
panel_54 = Panel(b_3)
panel_55 = Panel(c_3)
panel_56 = Panel(d_3)
panel_57 = Panel(a_3)
panel_58 = Panel(e_3)
panel_59 = Panel(f_3)
panel_60 = Panel(g_3)

g_4 = Data(python_32.h)
panel_61 = Panel(python_32.out)
item = ListItem(List=reverse(a_3), Index=0, Wrap=True)
bang = ExplodeTree(Data=a_3)  # -> Branch0, Branch1, Branch2
panel_62 = Panel(item)
viewer = ParamViewer(g_4)
