# Grasshopper definition Translation GH to PY.gh (Grasshopper 1.0.7)
# plug-ins: treesloth01, HFTidyCanvas

gate_permutaciones_o_combinaciones = GATEPermutacionesOCombinaciones(1)
combinationlength = Panel("3")
profundidad = Profundidad("8.805")
tipo_path = TipoPath(Tree({0}: ["{0}"], {1}: ["{1}"], {2}: ["{2}"], {3}: ["{3}"]))
codigo = Codigo(Tree({0}: ["0D-0D-CODIGO"], {1}: ["2D-2D-CODIGO"], {2}: ["3D-3D-CODIGO"], {3}: ["4D-4D-CODIGO"]))
area = Area(Tree({0}: ["40"], {1}: ["70"], {2}: ["80"], {3}: ["120"]))

panel = Panel(tipo_path)
panel_2 = Panel(combinationlength)
tipo_path_2 = TipoPath(simplify(graft(tipo_path)))
series = Series(Start="1", Step=1, Count="2")
# Nº de repeticiones X Nº tipologias
tipo_path_3 = TipoPath(tipo_path_2)
repeat = RepeatData(Data=tipo_path_3, Length=series)  # -> simplify(Data)
clean = CleanTree(RemoveNulls=True, RemoveInvalid=True, RemoveEmpty=True, Tree=repeat)
renumber = RenumberPaths(Data=clean)
packs_x = Packs(renumber)
tstat = TreeStatistics(Tree=packs_x)  # -> Paths, Length, Count
area_2 = Area(area)

tipo_path_4 = TipoPath(tstat.Paths)
packs_x_2 = PacksX(packs_x)
gate_permutaciones_o_combinaciones_2 = GATEPermutacionesOCombinaciones(gate_permutaciones_o_combinaciones)
combinationlength_2 = CombinationLength(combinationlength)

panel_3 = Panel(packs_x_2)

# ---- group: Permutaciones
combinationlength_3 = CombinationLength(combinationlength_2)
combinationlength_4 = Panel(combinationlength_3)
objects = Data(tipo_path_4)
python = PythonScript(Objects=objects, CombinationLength=combinationlength_4, OutputResults=Toggle(True))  # -> out, Permutations, Combinations; inputs Objects: list, CombinationLength: Int32
# ---------- python: Python ----------
import itertools as it
import Grasshopper as gh

def listToTree(nestedList):
    
    """ Convert a nested python iterable to a datatree """
    
    dt = gh.DataTree[object]()
    for i,l in enumerate(nestedList):
        dt.AddRange(l,gh.Kernel.Data.GH_Path(i))
        
    return dt
    #print dt

##itertools.combinations(iterable,r)

c = it.combinations(Objects,CombinationLength)
#p = it.permutations(Objects,CombinationLength)

print(c)

""""p = it.permutations(Objects)"""
"""c = it.combinations(Objects,CombinationLength)"""
"""    Permutations = listToTree(p)"""
if OutputResults:

    Combinations = listToTree(c)
#    Permutations = listToTree(p)
# ---------- end python ----------
gate_permutaciones_o_combinaciones_3 = GATEPermutacionesOCombinaciones(gate_permutaciones_o_combinaciones_2)
combinations = DataDescription(python.Combinations)
permutations = DataDescription(python.Permutations)
filter = StreamFilter(Gate=gate_permutaciones_o_combinaciones_3, Stream0=permutations, Stream1=combinations)

# ----
panel_4 = Panel(objects)
panel_5 = Panel(python.out)

combinaciones = Data(filter)
packs_x_3 = PacksX(packs_x_2)

panel_6 = Panel(packs_x_3)
panel_7 = Panel(combinaciones)

packs_x_4 = PacksX(packs_x_3)
data = DataDescription(combinaciones)

nº_combinaciones = NºCombinaciones(3304)
nº_combinaciones_2 = Panel(nº_combinaciones)

a_combinaciones_estructura_de_datos = ACombinacionesEstructuraDeDatos(Tree({0}: ["{0}"], {1}: ["{0}", "{0}"], {2}: ["{0}", "{0}", "{0}"], {3}: ["{0}", "{0}", "{0}", "{0}"], {4}: ["{0}", "{0}", "{0}", "{0}", "{0}"], {5}: ["{0}", "{0}", "{0}", "{0}", "{0}", "{0}"]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))
longitud_de_fachada = LongitudDeFachada(Tree({0}: ["4.5429"], {1}: ["4.5429", "4.5429"], {2}: ["4.5429", "4.5429", "4.5429"], {3}: ["4.5429", "4.5429", "4.5429", "4.5429"], {4}: ["4.5429", "4.5429", "4.5429", "4.5429", "4.5429"], {5}: ["4.5429", "4.5429", "4.5429", "4.5429", "4.5429", "4.5429"]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))

ejes = Ejes(Tree({0;1;0}: [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], {0;1;1}: [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]))
result = Result()

maximo = Maximo(0)
minimo = Minimo(0)

list = ValueList({"Combinaciones - Optimizar": 0, "Combinaciones - La maxima": 1}, selected="Combinaciones - La maxima")
list_2 = List(list)

panel_8 = Panel(result)

lng = ListLength(List=result)
series_2 = Series(Start=0, Step=1, Count=lng)
carl = CSharpScript(
    reset=Toggle(True),
    compName="Bob",
    ni=Slider(0, range=0..1),
    n=lng,
    endbound=result,
    decimals=Slider(0, range=0..5),
    sufix=series_2,
    prefix="wlc_")  # -> out; inputs reset: Boolean, compName: String, ni: Int32, n: Int32, endbound: list of Int32, decimals: Int32, sufix: list of String, prefix: String
# ---------- carl: C# ----------
    if(reset)
    {
      _n = n;
      _decimals = decimals;
      _ni = ni;
      _compName = compName;
      _endbound = endbound;
      _sufix = sufix;
      _prefix = prefix;
      GrasshopperDocument.ScheduleSolution(5, SolutionCallback);
    }
# ---------- carl: C# additional code ----------
  private int _n;
  private int _ni;
  private int _decimals;
  private string _compName;
  private List<int> _endbound;
  private List<string> _sufix;
  private string _prefix;
  private void SolutionCallback(GH_Document doc)
  {
    foreach(IGH_DocumentObject obj in GrasshopperDocument.Objects)
    {
      if (obj.NickName == _compName)
      {
        IGH_Component targetComponent = obj as IGH_Component;
        Random rnd = new Random();
        if(targetComponent.Params.Input[_ni].SourceCount > 0)
        {
          List<IGH_Param> sources = new List<IGH_Param>(targetComponent.Params.Input[_ni].Sources);
          GrasshopperDocument.RemoveObjects(sources, false);
        }
        for(int i = 0;i < _n;i++)
        {
          //instantiate  new slider
          Grasshopper.Kernel.Special.GH_NumberSlider slid = new Grasshopper.Kernel.Special.GH_NumberSlider();
          slid.CreateAttributes(); //sets up default values, and makes sure your slider doesn't crash rhino

          //customise slider (position, ranges etc)
          int inputcount = targetComponent.Params.Input[_ni].SourceCount;
          slid.Attributes.Pivot = new System.Drawing.PointF((float) targetComponent.Attributes.DocObject.Attributes.Bounds.Left - slid.Attributes.Bounds.Width - 30, (float) targetComponent.Params.Input[_ni].Attributes.Bounds.Y + inputcount * 30);
          slid.Slider.Maximum = _endbound[i];
          slid.Slider.Minimum = 0;
          slid.Slider.GripEdgeColour = System.Drawing.Color.FromArgb(255, 250, 120, 10);
          slid.Slider.TextColour = System.Drawing.Color.FromArgb(255, 250, 100, 10);
          slid.NickName = _prefix + _sufix[i];
          slid.Slider.DecimalPlaces = _decimals;
          slid.SetSliderValue(0);

          //Until now, the slider is a hypothetical object.
          // This command makes it 'real' and adds it to the canvas.
          GrasshopperDocument.AddObject(slid, false);

          //Connect the new slider to this component
          targetComponent.Params.Input[_ni].AddSource(slid);
        }
        break;
      }
    }
  }

  /// <summary>
  /// This method will be called once every solution, before any calls to RunScript.
  /// </summary>
  public override void BeforeRunScript()
  { }
  /// <summary>
  /// This method will be called once every solution, after any calls to RunScript.
  /// </summary>
  public override void AfterRunScript()
  { }
# ---------- end carl ----------
bob = GhPythonScript()  # -> a
# ---------- bob: Python ----------
__author__ = "srodriguez"
__version__ = "2021.09.29"

import rhinoscriptsyntax as rs
a = y
# ---------- end bob ----------
a = DataDescription(bob)
filter_2 = StreamFilter(Gate=list_2, Stream0=a, Stream1=result)
a_2 = DataDescription(filter_2)

a_combinaciones_estructura_de_datos_2 = ACombinacionesEstructuraDeDatos(a_combinaciones_estructura_de_datos)
longitud_de_fachada_2 = LongitudDeFachada(longitud_de_fachada)
minimo_2 = Minimo(minimo)
maximo_2 = Maximo(maximo)
ejes_2 = Ejes(ejes)
cluster = Cluster_4(
    curve=ejes_2,
    a_combinaciones_estructura_de_datos=a_combinaciones_estructura_de_datos_2,
    longitud_de_fachada=longitud_de_fachada_2,
    minimo=minimo_2,
    maximo=maximo_2)  # -> comida_para_bob_6, paths_10, paths_11, list_2, longitud_de_fachada_ordenado_4, estructura_tramos_3
result_2 = Result(cluster.comida_para_bob_6)
result_3 = Result(result_2)
cluster_2 = Cluster_3(
    A=result_3,
    paths=cluster.paths_10,
    paths_2=cluster.paths_11,
    list=cluster.list_2,
    longitud_de_fachada_ordenado=cluster.longitud_de_fachada_ordenado_4,
    estructura_tramos=cluster.estructura_tramos_3)  # -> data_3, data_4
longitud_fachada = LongitudFachada(cluster_2.data_4)
x = X(cluster_2.data_3)

result_4 = Panel(result_3)
ejes_3 = Ejes(Tree({0;1;0}: [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], {0;1;1}: [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]))

maximo_3 = Maximo(0)
minimo_3 = Minimo(0)

b_combinaciones = ACombinacionesEstructuraDeDatos(Tree({0}: ["{0}"], {1}: ["{0}", "{0}"], {2}: ["{1}"], {3}: ["{1}", "{1}"], {4}: ["{2}"], {5}: ["{2}", "{2}"]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))
longitud_de_fachada_3 = LongitudDeFachada(Tree({0}: ["4.5429"], {1}: ["4.5429", "4.5429"], {2}: ["7.95"], {3}: ["7.95", "7.95"], {4}: ["9.0857"], {5}: ["9.0857", "9.0857"]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))

maximo_4 = Maximo("0")
minimo_4 = Minimo("0.50")
ejes_4 = Ejes(Tree({0;1;0}: [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], {0;1;1}: [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]))
longitud_de_fachada_4 = LongitudDeFachada(longitud_de_fachada_3)
b_combinaciones_2 = ACombinacionesEstructuraDeDatos(b_combinaciones)
maximo_5 = Maximo(maximo_4)
minimo_5 = Minimo(minimo_4)
ejes_5 = Ejes(ejes_4)
panel_9 = Panel(b_combinaciones_2)
panel_10 = Panel(longitud_de_fachada_4)
len = Length(Curve=ejes_5)

longitud_de_fachada_5 = LongitudDeFachada(longitud_de_fachada_4)

panel_11 = Panel(longitud_de_fachada_5)
ma = MassAddition(Input=longitud_de_fachada_5)  # -> Result, PartialResults
length = Length(len)

# ----
# Se ordenan las combinaciones por la longitud que adquiere cada combinacion
ma_2 = MassAddition(Input=longitud_de_fachada_5)  # -> Result, PartialResults
tstat_2 = TreeStatistics(Tree=ma_2.Result)  # -> Paths, Length, Count
panel_12 = Panel(ma_2.Result)
paths = DataDescription(tstat_2.Paths)
sort = SortList(Keys=flatten(panel_12), ValuesA=paths)  # -> graft(Keys), ValuesA
x_ordenados = DataDescription(sort.ValuesA)
panel_13 = Panel(panel_12)
paths_2 = Paths(paths)

lng_2 = ListLength(List=flatten(length))
division = Division(A=lng_2, B=2)
nº_de_ejes_a_encajar = DataDescription(division)
sort_2 = SortList(Keys=flatten(panel_12), ValuesA=paths)  # -> Keys, ValuesA
length_2 = Length(length)
minimo_6 = Minimo(minimo_5)
maximo_6 = Maximo(maximo_5)
nº_de_ejes_a_encajar_2 = Panel(nº_de_ejes_a_encajar)
panel_14 = Panel(sort_2.ValuesA)

# ----
# Longitudes maximas de los tramos
length_3 = Length(length_2)
length_4 = Length(flatten(length_3))
partition = PartitionList(List=length_4, Size="2")
ejes_6 = Ejes(partition)
tstat_3 = TreeStatistics(Tree=simplify(ejes_6))  # -> Paths, Length, Count
item = ListItem(List=ejes_6, Index=0, Wrap=True)
estructura_tramos = DataDescription(tstat_3.Paths)
panel_15 = DataDescription(simplify(item))

# ---- group: Dominios para el filtro de combinaciones
minimo_7 = Minimo(minimo_6)
panel_16 = Panel(panel_15)
maximo_7 = Maximo(maximo_6)
domain = DataDescription(Tree({0}: [Domain(6.020812011, 12.04162402)], {1}: [Domain(6.020812011, 12.04162402)]))

# ----
panel_17 = Panel(panel_15)

# ---- group: Dominios para el filtro de combinaciones
multiplication = Multiplication(A=panel_16, B=maximo_7)
addition = Addition(A=panel_16, B=maximo_7)
multiplication_2 = Multiplication(A=panel_16, B=minimo_7)
dom = ConstructDomain(DomainStart=multiplication_2, DomainEnd=addition)

# ----
# 0. COMBINACIONES - ANALISIS
suma_longitudes_de_fachada = SumaLongitudesDeFachada(flatten([4.1652, 4.5001, 6.3641, 8.3304, 9.0002, 9.6563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]))

panel_18 = Panel(dom)
domain_2 = DataDescription(Tree({0}: [Domain(6.020812011, 12.04162402)], {1}: [Domain(6.020812011, 12.04162402)]))

# ----
# Todas las COMBINACIONES Se han ordenado segun la longitud total de esa combinacion - OPCIONES A ENCAJAR.
# 
# Tiene que pasar por un filtro para agilizar la optimizacion -->
# <-------------Slider---------------->
suma_longitudes_de_fachada_2 = QuickGraph(suma_longitudes_de_fachada, SortOrder=0)

estructura_tramos_2 = EstructuraTramos(estructura_tramos)
estructura_tramos_3 = EstructuraTramos(estructura_tramos_2)

packs_x_5 = PacksX(packs_x_4)
combinaciones_2 = Data(data)

panel_19 = Panel(packs_x_5)

dpath = DeconstructPath(Branch=combinaciones_2)
tstat_4 = TreeStatistics(Tree=packs_x_5)  # -> Paths, Length, Count
branch = TreeBranch(Tree=packs_x_5, Path=combinaciones_2, MaintainPaths=False)  # -> flatten(Branch)
pshift = ShiftPaths(Data=dpath, Offset=-1)
item_2 = ListItem(List=tstat_4.Length, Index=pshift, Wrap=True)
ma_3 = MassAddition(Input=item_2)  # -> flatten(Result), PartialResults
partition_2 = PartitionList(List=branch, Size=ma_3.Result)  # -> simplify(Chunks)
a_combinaciones_estructura_de_datos_3 = BCombinaciones(partition_2)

panel_20 = Panel(tstat_4.Length)
panel_21 = Panel(pshift)
panel_22 = Panel(item_2)
panel_23 = Panel(ma_3.Result)
panel_24 = Panel(branch)
panel_25 = Panel(partition_2)

a_combinaciones_estructura_de_datos_4 = ACombinacionesEstructuraDeDatos(a_combinaciones_estructura_de_datos_3)
packs_x_6 = PacksX(packs_x_5)
entwine = Entwine(Branch0X=packs_x_6, Branch1X=a_combinaciones_estructura_de_datos_4, FlattenInputs=False)  # -> simplify(Result)
renumber_2 = RenumberPaths(Data=entwine)
b_combinaciones_3 = DataDescription(renumber_2)

b_combinaciones_4 = BCombinaciones(b_combinaciones_3)

panel_26 = Panel(b_combinaciones_4)

profundidad_2 = Profundidad(profundidad)
b_combinaciones_5 = BCombinaciones(b_combinaciones_4)
codigo_2 = Codigo(codigo)
area_3 = Area(area_2)

panel_27 = Panel(area_3)
panel_28 = Panel(profundidad_2)
panel_29 = Panel(b_combinaciones_5)

codigo_3 = Codigo(codigo_2)
cluster_3 = Cluster_2(area_longitud_fachada=area_3, profundidad=profundidad_2)  # -> area_longitud_fachada_6, profundidad_5
b_combinaciones_6 = BCombinaciones(b_combinaciones_5)
b_combinaciones_7 = BCombinaciones(b_combinaciones_5)
cluster_4 = Cluster(BCombinaciones=b_combinaciones_6, LongitudDeFachada=cluster_3.profundidad_5)
cluster_5 = Cluster(BCombinaciones=b_combinaciones_7, Panel=codigo_3)

panel_30 = Panel(cluster_3.profundidad_5)
panel_31 = Panel(cluster_4)

longitud_de_fachada_6 = DataDescription(cluster_4)
b_combinaciones_8 = BCombinaciones(b_combinaciones_5)
codigo_4 = DataDescription(cluster_5)

# ----
# Estructura de datos
# Codigo
# Longitud de fachada
longitud_de_fachada_7 = LongitudDeFachada(longitud_de_fachada_6)
b_combinaciones_9 = BCombinacionesEstructuraDeDatos(b_combinaciones_8)
codigo_5 = Codigo(codigo_4)

longitud_de_fachada_8 = LongitudDeFachada(longitud_de_fachada_7)
tstat_5 = TreeStatistics(Tree=longitud_de_fachada_8)  # -> Paths, Length, Count
numero_de_combinaciones = Branch4(tstat_5.Count)

numero_de_combinaciones_2 = Panel(numero_de_combinaciones)
numero_de_combinaciones_3 = Branch4(numero_de_combinaciones)
longitud_de_fachada_9 = LongitudDeFachada(longitud_de_fachada_7)
b_combinaciones_10 = BCombinacionesEstructuraDeDatos(b_combinaciones_9)
codigo_6 = Codigo(codigo_5)

numero_de_combinaciones_4 = NumeroDeCombinaciones(numero_de_combinaciones)
numero_de_combinaciones_5 = Panel(numero_de_combinaciones_4)

b_combinaciones_11 = BCombinaciones(b_combinaciones_9)
longitud_de_fachada_10 = LongitudDeFachada(longitud_de_fachada_7)

longitud_de_fachada_11 = Panel(longitud_de_fachada_10)
longitud_de_fachada_12 = Panel(b_combinaciones_11)

b_combinaciones_12 = ACombinacionesEstructuraDeDatos(b_combinaciones_2)
x_ordenados_2 = XOrdenados(x_ordenados)
paths_3 = Paths(paths_2)

# ----
# Podría hacerlo en python
b_combinaciones_13 = ACombinacionesEstructuraDeDatos(b_combinaciones_12)

# ----
# Longitudes Fachada
longitud_de_fachada_13 = Panel(longitud_de_fachada_5)
x_ordenados_3 = XOrdenados(x_ordenados)
paths_4 = Paths(paths_2)

replace = ReplacePaths(Data=longitud_de_fachada_13, Search=x_ordenados_3, Replace=paths_4)
replace_2 = ReplacePaths(Data=b_combinaciones_13, Search=x_ordenados_2, Replace=paths_3)

longitud_de_fachada_ordenado = DataDescription(replace)

paths_5 = DataDescription(replace_2)

panel_32 = Panel(longitud_de_fachada_ordenado)
longitud_de_fachada_ordenado_2 = LongitudDeFachadaOrdenado(longitud_de_fachada_ordenado)
paths_6 = Paths(paths_5)
ma_4 = MassAddition(Input=longitud_de_fachada_ordenado_2)  # -> Result, PartialResults

suma_de_longitudes_de_fachada_ordenado = LongitudesDeFachadaOrdenado(flatten(ma_4.Result))
inc = Includes(Value=suma_de_longitudes_de_fachada_ordenado, Domain=domain)  # -> Includes, Deviation
tstat_6 = TreeStatistics(Tree=inc.Includes)  # -> Paths, Length, Count
bool = Boolean(inc.Includes)
boolean = DataDescription(bool)

longitud_de_fachada_ordenado_3 = LongitudDeFachadaOrdenado(longitud_de_fachada_ordenado_2)
panel_33 = Panel(suma_de_longitudes_de_fachada_ordenado)
tstat_7 = TreeStatistics(Tree=longitud_de_fachada_ordenado_3)  # -> Paths, Length, Count
paths_7 = DataDescription(tstat_7.Paths)
count = DataDescription(tstat_7.Count)
panel_34 = Panel(count)
series_3 = Series(Start=0, Step=1, Count=panel_34)
repeat_2 = RepeatData(Data=panel_34, Length=tstat_6.Count)  # -> graft(Data)
repeat_3 = RepeatData(Data=series_3, Length=repeat_2)  # -> simplify(Data)

boolean_2 = Boolean(boolean)
ma_5 = MassAddition(Input=boolean_2)  # -> Result, PartialResults
cull = CullPattern(List=ma_5.PartialResults, CullPattern=boolean_2)
item_3 = ListItem(List=cull, Index=-1, Wrap=True)
comida_para_bob = DataDescription(item_3)

panel_35 = Panel(boolean)

# ----
# Cuanto mas largo el tramo, mayor nº de combinaciones
# <-------------Slider---------------->
# Aplicamos el filtro
graph = QuickGraph(ma_5.PartialResults, SortOrder=0)
comida_para_bob_2 = Panel(comida_para_bob)

cull_2 = CullPattern(List=repeat_3, CullPattern=boolean)
panel_36 = Panel(cull_2)
viewer = ParamViewer(cull_2)
# Paths reales viviendas
paths_8 = Paths(paths_6)
# Paths reales viviendas
paths_9 = Paths(paths_7)
list_3 = DataDescription(cull_2)
comida_para_bob_3 = COMIDAPARABOB(comida_para_bob)
panel_38 = Panel(list_3)
panel_39 = Panel(paths_9)
panel_40 = Panel(paths_8)

comida_para_bob_4 = Panel(comida_para_bob_3)
lng_3 = ListLength(List=comida_para_bob_4)
repeat_4 = RepeatData(Data="0", Length=lng_3)
null = NullItem(Item=comida_para_bob_4)  # -> NullFlags, InvalidFlags, Description
int = Integer(null.NullFlags)
merge = Merge(Data1=simplify(comida_para_bob_4), Data2=simplify(int))
clean_2 = CleanTree(RemoveNulls=True, RemoveInvalid=True, RemoveEmpty=False, Tree=merge)
ma_6 = MassAddition(Input=clean_2)  # -> flatten(Result), PartialResults
subtraction = Subtraction(A=ma_6.Result, B="1")
comida_para_bob_5 = DataDescription(subtraction)
panel_41 = Panel(comida_para_bob_5)

comida_para_bob_6 = COMIDAPARABOB(comida_para_bob_5)
longitud_de_fachada_ordenado_4 = LongitudDeFachadaOrdenado(longitud_de_fachada_ordenado_3)
comida_para_bob_7 = COMIDAPARABOB(comida_para_bob_6)
paths_10 = Paths(paths_8)
paths_11 = Paths(paths_9)
list_4 = List(list_3)
cluster_6 = Cluster_3(
    A=comida_para_bob_7,
    paths=paths_10,
    paths_2=paths_11,
    list=list_4,
    longitud_de_fachada_ordenado=longitud_de_fachada_ordenado_4,
    estructura_tramos=estructura_tramos_3)  # -> data_3, data_4
longitud_fachada_2 = LongitudFachada(cluster_6.data_4)
x_2 = X(cluster_6.data_3)

# ==== cluster Cluster
panel = Panel(ClusterInput())
panel_2 = Panel(ClusterInput())
num = Number(panel_2)
panel_3 = Panel(panel_2)
dpath = DeconstructPath(Branch=panel)
lng = ListLength(List=panel)  # -> flatten(Length)
tstat = TreeStatistics(Tree=panel_2)  # -> Paths, Length, Count
pshift = ShiftPaths(Data=dpath, Offset=-1)  # -> flatten(Data)
dpath_2 = DeconstructPath(Branch=tstat.Paths)
flatten = FlattenTree(Tree=panel_2, Path="{0}")
pshift_2 = ShiftPaths(Data=dpath_2, Offset=-1)
panel_4 = Panel(pshift_2)
mindex = MemberIndex(Set=pshift_2, Member=pshift)  # -> Index, Count
shift = ShiftPaths(Data=mindex.Index, Offset=-1)
partition = PartitionList(List=shift, Size=lng)
item = ListItem(List=flatten, Index=partition, Wrap=True)  # -> simplify(Item)
i = ClusterOutput(item)
panel_5 = Panel(item)

# ==== cluster Cluster_2
area_longitud_fachada = ClusterInput()
profundidad = ClusterInput()
profundidad_2 = B(profundidad)
area_longitud_fachada_2 = A(area_longitud_fachada)
area_longitud_fachada_3 = A(flatten(area_longitud_fachada_2))
panel = Panel(area_longitud_fachada_3)
num = Number(area_longitud_fachada_3)
area_longitud_fachada_4 = Panel(area_longitud_fachada_2)
profundidad_3 = Panel(profundidad_2)
sort = SortList(Keys=area_longitud_fachada_3)  # -> reverse(Keys), ValuesA
viewer = ParamViewer(sort.Keys)
avr = Average(Input=sort.Keys)
item = ListItem(List=sort.Keys, Index=0, Wrap=True)
panel_2 = Panel(avr)
panel_3 = Panel(item)
division = Division(A=profundidad_3, B=panel_2)
panel_4 = Panel("12")
division_2 = Division(A=profundidad_3, B=panel_2)
similar = Similarity(FirstNumber=panel_2, SecondNumber=profundidad_3, Threshold="0.20")  # -> Similarity, AbsoluteDifference
division_3 = Division(A=area_longitud_fachada_2, B=profundidad_2)
panel_5 = Panel(division_2)
multiplication = Multiplication(A=area_longitud_fachada_2, B=profundidad_2)
panel_6 = Panel(similar.Similarity)
panel_7 = Panel(multiplication)
panel_8 = Panel(division_3)
larger = LargerThan(FirstNumber=panel_3, SecondNumber=profundidad_2)  # -> LargerThan, OrEqualTo
larger_2 = LargerThan(FirstNumber=panel_5, SecondNumber="0.5")  # -> LargerThan, OrEqualTo
panel_9 = Panel(larger.LargerThan)
filter = StreamFilter(Gate=0, Stream0=panel_7, Stream1=panel_8)
panel_10 = Panel(larger_2.LargerThan)
filter_2 = StreamFilter(Gate=panel_10, Stream0=panel_8, Stream1=panel_7)
area_longitud_fachada_5 = A(area_longitud_fachada_2)
profundidad_4 = EncajePorAreasLongitudesFach(filter_2)
area_longitud_fachada_6 = ClusterOutput(area_longitud_fachada_5)
profundidad_5 = ClusterOutput(profundidad_4)

# ==== cluster Cluster_3
estructura_tramos = ClusterInput()
longitud_de_fachada_ordenado = ClusterInput()
paths = ClusterInput()
paths_2 = ClusterInput()
list = ClusterInput()

estructura_tramos_2 = EstructuraTramos(estructura_tramos)
estructura_tramos_3 = EstructuraTramos(estructura_tramos_2)
estructura_tramos_4 = EstructuraTramos(estructura_tramos_3)

longitud_de_fachada_ordenado_2 = LongitudDeFachadaOrdenado(longitud_de_fachada_ordenado)
paths_3 = Paths(paths)
paths_4 = Paths(paths_2)
list_2 = List(list)

panel = Panel(ClusterInput())
panel_2 = Number(panel)

paths_5 = Paths(paths_3)
paths_6 = Paths(paths_4)
list_3 = List(list_2)
longitud_de_fachada_ordenado_3 = LongitudDeFachadaOrdenado(longitud_de_fachada_ordenado_2)
longitud_de_fachada_ordenado_4 = LongitudDeFachadaOrdenado(longitud_de_fachada_ordenado_3)
paths_7 = Paths(paths_6)
list_4 = List(list_3)
item = ListItem(List=list_4, Index=graft(panel_2), Wrap=True)
item_2 = ListItem(List=paths_7, Index=item, Wrap=True)  # -> flatten(Item)
item_3 = DataDescription(item_2)
longitud_de_fachada_ordenado_5 = Data(longitud_de_fachada_ordenado_4)
branch = TreeBranch(Tree=paths_5, Path=item_3, MaintainPaths=False)  # -> simplify(Branch)
panel_3 = Panel(item_2)
branch_2 = TreeBranch(Tree=longitud_de_fachada_ordenado_5, Path=item_3, MaintainPaths=False)  # -> simplify(Branch)
estructura_tramos_5 = EstructuraTramos(estructura_tramos_3)
tstat = TreeStatistics(Tree=branch_2)  # -> Paths, Length, Count
paths_8 = DataDescription(tstat.Paths)
length = DataDescription(tstat.Length)
count = DataDescription(tstat.Count)
replace = ReplacePaths(Data=branch, Search=paths_8, Replace=estructura_tramos_4)
replace_2 = ReplacePaths(Data=branch_2, Search=paths_8, Replace=estructura_tramos_5)
data = DataDescription(replace)
data_2 = DataDescription(replace_2)
data_3 = ClusterOutput(data)
data_4 = ClusterOutput(data_2)
panel_4 = Panel(data_2)

# ==== cluster Cluster_4
a_combinaciones_estructura_de_datos = ClusterInput()
curve = ClusterInput()
minimo = ClusterInput()
maximo = ClusterInput()
longitud_de_fachada = ClusterInput()
a_combinaciones_estructura_de_datos_2 = ACombinacionesEstructuraDeDatos(a_combinaciones_estructura_de_datos)
curve_2 = Curve(curve)
minimo_2 = Minimo(minimo)
maximo_2 = Maximo(maximo)
longitud_de_fachada_2 = LongitudDeFachada(longitud_de_fachada)
curve_3 = Curve(curve_2)
len = Length(Curve=curve_3)

longitud_de_fachada_3 = LongitudDeFachada(longitud_de_fachada_2)

ma = MassAddition(Input=longitud_de_fachada_3)  # -> Result, PartialResults
length = Length(len)

# ----
# Se ordenan las combinaciones por la longitud que adquiere cada combinacion
ma_2 = MassAddition(Input=longitud_de_fachada_3)  # -> Result, PartialResults
tstat = TreeStatistics(Tree=ma_2.Result)  # -> Paths, Length, Count
panel = Panel(ma_2.Result)
paths = DataDescription(tstat.Paths)
sort = SortList(Keys=flatten(panel), ValuesA=paths)  # -> graft(Keys), ValuesA
x_ordenados = DataDescription(sort.ValuesA)
paths_2 = Paths(paths)
panel_2 = Panel(panel)

lng = ListLength(List=flatten(length))
division = Division(A=lng, B=2)
nº_de_ejes_a_encajar = DataDescription(division)
sort_2 = SortList(Keys=flatten(panel), ValuesA=paths)  # -> Keys, ValuesA
length_2 = Length(length)
minimo_3 = Minimo(minimo_2)
maximo_3 = Maximo(maximo_2)
nº_de_ejes_a_encajar_2 = Panel(nº_de_ejes_a_encajar)
panel_3 = Panel(sort_2.ValuesA)

# ----
# Longitudes maximas de los tramos
length_3 = Length(length_2)
length_4 = Length(flatten(length_3))
partition = PartitionList(List=length_4, Size="2")
ejes = Ejes(partition)
tstat_2 = TreeStatistics(Tree=simplify(ejes))  # -> Paths, Length, Count
item = ListItem(List=ejes, Index=0, Wrap=True)
estructura_tramos = DataDescription(tstat_2.Paths)
panel_4 = DataDescription(simplify(item))

# ----
# 0. COMBINACIONES - ANALISIS
suma_longitudes_de_fachada = SumaLongitudesDeFachada(flatten([4.1652, 4.5001, 6.3641, 8.3304, 9.0002, 9.6563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]))

# ----
# Todas las COMBINACIONES Se han ordenado segun la longitud total de esa combinacion - OPCIONES A ENCAJAR.
# 
# Tiene que pasar por un filtro para agilizar la optimizacion -->
# <-------------Slider---------------->
suma_longitudes_de_fachada_2 = QuickGraph(suma_longitudes_de_fachada, SortOrder=0)

estructura_tramos_2 = EstructuraTramos(estructura_tramos)
estructura_tramos_3 = ClusterOutput(estructura_tramos_2)

a_combinaciones_estructura_de_datos_3 = ACombinacionesEstructuraDeDatos(a_combinaciones_estructura_de_datos_2)
x_ordenados_2 = XOrdenados(x_ordenados)
paths_3 = Paths(paths_2)

# ----
# Podría hacerlo en python
a_combinaciones_estructura_de_datos_4 = ACombinacionesEstructuraDeDatos(a_combinaciones_estructura_de_datos_3)

# ----
# Longitudes Fachada
longitud_de_fachada_4 = Panel(longitud_de_fachada_3)
x_ordenados_3 = XOrdenados(x_ordenados)
paths_4 = Paths(paths_2)

# ----
# Suma Longitudes de Fachada
panel_5 = Panel(panel_2)
x_ordenados_4 = XOrdenados(x_ordenados)
paths_5 = Paths(paths_2)

replace = ReplacePaths(Data=longitud_de_fachada_4, Search=x_ordenados_3, Replace=paths_4)
replace_2 = ReplacePaths(Data=panel_5, Search=x_ordenados_4, Replace=paths_5)
replace_3 = ReplacePaths(Data=a_combinaciones_estructura_de_datos_4, Search=x_ordenados_2, Replace=paths_3)

longitudes_de_fachada_ordenado = DataDescription(replace_2)

longitud_de_fachada_ordenado = DataDescription(replace)

paths_6 = DataDescription(replace_3)

longitud_de_fachada_ordenado_2 = LongitudDeFachadaOrdenado(longitud_de_fachada_ordenado)
tstat_3 = TreeStatistics(Tree=longitud_de_fachada_ordenado_2)  # -> Paths, Length, Count
paths_7 = DataDescription(tstat_3.Paths)
count = DataDescription(tstat_3.Count)
panel_6 = Panel(count)
series = Series(Start=0, Step=1, Count=panel_6)
paths_8 = Paths(paths_6)
paths_9 = Paths(paths_7)
longitud_de_fachada_ordenado_3 = LongitudDeFachadaOrdenado(longitud_de_fachada_ordenado_2)
paths_10 = ClusterOutput(paths_8)
paths_11 = ClusterOutput(paths_9)
longitud_de_fachada_ordenado_4 = ClusterOutput(longitud_de_fachada_ordenado_2)

longitudes_de_fachada_ordenado_2 = LongitudesDeFachadaOrdenado(flatten(longitudes_de_fachada_ordenado))

# ---- group: Dominios para el filtro de combinaciones
minimo_4 = Minimo(minimo_3)
maximo_4 = Maximo(maximo_3)
panel_7 = Panel(panel_4)

multiplication = Multiplication(A=panel_7, B=maximo_4)
addition = Addition(A=panel_7, B=multiplication)
multiplication_2 = Multiplication(A=panel_7, B=minimo_4)
dom = ConstructDomain(DomainStart=multiplication_2, DomainEnd=addition)

domain = DataDescription(dom)

# ----
inc = Includes(Value=longitudes_de_fachada_ordenado_2, Domain=domain)  # -> Includes, Deviation
tstat_4 = TreeStatistics(Tree=inc.Includes)  # -> Paths, Length, Count
bool = Boolean(inc.Includes)
boolean = DataDescription(bool)

repeat = RepeatData(Data=panel_6, Length=tstat_4.Count)  # -> graft(Data)
repeat_2 = RepeatData(Data=series, Length=repeat)  # -> simplify(Data)

boolean_2 = Boolean(boolean)
ma_3 = MassAddition(Input=boolean_2)  # -> Result, PartialResults
cull = CullPattern(List=ma_3.PartialResults, CullPattern=boolean_2)
item_2 = ListItem(List=cull, Index=-1, Wrap=True)
comida_para_bob = DataDescription(item_2)

# ----
# Se Descartan directamente todas las combinaciones que no entren dentro de los dominios
# 
# - Linea recta indica Fin de la busqueda
# - Linea inclinada representa las combinaciones que entrarian a optimizar
# Cuanto mas largo el tramo, mayor nº de combinaciones
# <-------------Slider---------------->
# Aplicamos el filtro
graph = QuickGraph(ma_3.PartialResults, SortOrder=0)
comida_para_bob_2 = Panel(comida_para_bob)

cull_2 = CullPattern(List=repeat_2, CullPattern=boolean)
list = DataDescription(cull_2)
comida_para_bob_3 = COMIDAPARABOB(comida_para_bob)
list_2 = ClusterOutput(list)
comida_para_bob_4 = Panel(comida_para_bob_3)
lng_2 = ListLength(List=comida_para_bob_4)
repeat_3 = RepeatData(Data="0", Length=lng_2)
null = NullItem(Item=comida_para_bob_4)  # -> NullFlags, InvalidFlags, Description
int = Integer(null.NullFlags)
merge = Merge(Data1=simplify(comida_para_bob_4), Data2=simplify(int))
clean = CleanTree(RemoveNulls=True, RemoveInvalid=True, RemoveEmpty=False, Tree=merge)
ma_4 = MassAddition(Input=clean)  # -> flatten(Result), PartialResults
subtraction = Subtraction(A=ma_4.Result, B="1")
comida_para_bob_5 = DataDescription(subtraction)
comida_para_bob_6 = ClusterOutput(comida_para_bob_5)
comida_para_bob_7 = Panel(comida_para_bob_5)
